# Grasshopper definition connect-by-order.gh (Grasshopper 1.0.7)

# ---- group: nodes.txt
coordinate_filepath = FilePath("d:\Users\ADMIN\Desktop\nogui\rhino\nodes.txt")

# ---- group: elements.txt
connect_filepath = FilePath("d:\Users\ADMIN\Desktop\nogui\rhino\elements.txt")

# ----
file = ReadFile(File=connect_filepath, PerLineParse=True)
coords = ImportCoordinates(File=coordinate_filepath, Separator=",", XIndex=0, YIndex=1, ZIndex=2)
split = TextSplit(Text=file, Separators=",")
item = ListItem(List=split, Index="0", Wrap=True)  # -> Item, Item1
item_2 = ListItem(List=coords, Index=item.Item, Wrap=True)
item_3 = ListItem(List=coords, Index=item.Item1, Wrap=True)
ln = Line(StartPoint=item_2, EndPoint=item_3)
join = JoinCurves(Curves=ln, Preserve=False)
c_script = CSharpScript(geometries=join)  # -> A; inputs geometries: tree of GeometryBase
# ---------- c_script: C# usings ----------
using System.IO;
# ---------- c_script: C# ----------
    var guids = new List<Guid>();


    for (int i = 0; i < geometries.BranchCount; i++)
    {
      for (int n = 0; n < geometries.Branches[i].Count; n++)
      {
        var geom = geometries.Branches[i][n];
        var guid = Rhino.RhinoDoc.ActiveDoc.Objects.Add(geom);
        guids.Add(guid);
      }
    }

    int suc = Rhino.RhinoDoc.ActiveDoc.Objects.Select(guids);

    if (suc > 0)
    {
      A = "success";
    }
    else
    {
      A = null;
    }
# ---------- end c_script ----------
panel = Panel(c_script)
geo = Geometry()
python = GhPythonScript(G=geo, L="TestLayers")  # -> a; inputs G: Guid
# ---------- python: Python ----------
"""Provides a scripting component.
    Inputs:
        G: Geometry to bake
        L: Layer name for bake
    Output:
        a: The a output variable"""

__author__ = "ADMIN"
__version__ = "2024.01.03"

import rhinoscriptsyntax as rs
import scriptcontext
import Rhino


print(type(G)) #debug message to Python output

#we obtain the reference in the Rhino doc
doc_object = scriptcontext.doc.Objects.Find(G)
print(type(doc_object))

attributes = doc_object.Attributes
print('the type of attributes is: ' + str(type(attributes)))     #debug message to Python output

geometry = doc_object.Geometry
print('the type of geometry is: ' + str(type(doc_object)))     #debug message to Python output

#we change the scriptcontext
scriptcontext.doc = Rhino.RhinoDoc.ActiveDoc

#we add both the geometry and the attributes to the Rhino doc
rhino_brep = scriptcontext.doc.Objects.Add(geometry, attributes)
print('the Rhino doc ID is: ' + str(rhino_brep))     #debug message to Python output

#we can for example change the layer in Rhino...
if not rs.IsLayer(L):
    rs.AddLayer(L)
rs.ObjectLayer(rhino_brep, L)

#we put back the original Grasshopper document as default
scriptcontext.doc = ghdoc
a = G
# ---------- end python ----------
